# Grasshopper definition Pu.gh (Grasshopper 0.9.76)
# plug-ins: Python Interpreter, VirtualWindTunnel

number_slider = Slider(1, range=0..1)
wind_dir = ControlKnob(Decimals=0, Limit=True, Maximum=359, Minimum=0, Range=360, Value=151)
geo = Geometry(<brep referenced from the Rhino model>)
domaincyl = DomainCyl(
    Geometry=geo,
    Directory="C:\MeshingPaper\Pu\",
    WindDir=wind_dir,
    DivisionsOuterCirc="2",
    DivisionsZ=Slider(1, range=1..100),
    ScaleInnerR=Slider(1, range=0..100),
    RAM=number_slider,
    CPUs=number_slider,
    Run=Button())  # -> Out, Domain, Cyl
xz = XZPlane(Origin=Point(-0.0485980799, -4.042677826, 0))
c_script = CSharpScript(p=xz)  # -> out, B, A; inputs b: list of Brep, p: Plane
# ---------- c_script: C# ----------
    double pj = 0;
    A = FindFacades(p, b, out pj);
    B = pj;
# ---------- c_script: C# additional code ----------
  static List<Brep> FindFacades(Plane plane, List<Brep> volumes, out double projectedAreaTotal)
  {
    List<Brep> Facades = new List<Brep>();

    List<double> projectedAreas = new List<double>();
    foreach (Brep b in volumes)
    {
      for (int i = 0; i < b.Faces.Count; i++)
      {
        Vector3d vSurf = b.Faces[i].NormalAt(0.5, 0.5);
        double dot = plane.ZAxis * vSurf;
        if (dot < 0.1) continue;


        Brep face = b.Faces[i].DuplicateFace(false);
        //Print(dot + "");
        Facades.Add(face);

        Vector3d cross = Vector3d.CrossProduct(plane.ZAxis, vSurf);
        double norm = cross.Length;
        double angle = Math.Atan2(norm, dot);

        //Print((angle * 180 / Math.PI) + "");

        double projectedArea = face.GetArea() * Math.Cos(angle);

        projectedAreas.Add(projectedArea);
        //Print(projectedArea + "");
      }
    }
    projectedAreaTotal = projectedAreas.Sum(x => x);

    return Facades;
  }
# ---------- end c_script ----------
number_slider_2 = Slider(1, range=0..10)
panel = Panel(c_script.B)
mesh = Mesh(
    Domain=domaincyl.Domain,
    AccBuilding=number_slider_2,
    AccFeatures=number_slider_2,
    AccGround=Slider(1, range=0..10),
    Layer=Slider(3, range=0..10),
    Run=Button())  # -> Out, Domain
python = PythonScript()  # -> out, a, b, c, d, e, f
# ---------- python: Python ----------
a=x.BBox
b=x.centerGroundBBox
c=x.BBox.Min
d=x.BBox.Max
e=x.dimY
f=x.newBoxDomain.GetCorners
# ---------- end python ----------
panel_2 = Panel(python.b)
panel_3 = Panel(python.f)
panel_4 = Panel(python.a)
panel_5 = Panel(python.c)
button = Button()
simulation = Simulation(
    Domain=mesh.Domain,
    Iterations=Slider(1000, range=0..1000),
    WriteInterval=Slider(10, range=0..100),
    KeepTimeSteps=Slider(5, range=0..10),
    Run_2=False)
