# Grasshopper definition 4_AnnualWindAnalysis.ghx (Grasshopper 1.0.7)
# plug-ins: Eddy3D

panel = Panel("https://energyplus-weather.s3.amazonaws.com/north_and_central_america_wmo_region_4/USA/TX/USA_TX_Amarillo.Intl.AP.723630_TMY3/USA_TX_Amarillo.Intl.AP.723630_TMY3.epw")
# 5. Post-processing
# 5.1. Paraview
# 5.2. Grasshopper
button = Button()
dir = Slider(2, range=0..7)
# 5.3. Grasshopper
button_2 = Button()
panel_2 = Panel("55")  # disabled
panel_3 = Panel("-1")  # disabled
number_slider = Slider(3, range=0..10)  # disabled

# ----
# 1. Geometry &
# Boundary Conditions
panel_4 = Panel("""0
22
45
90
135
180
225
270
315""")
geo = Geometry([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])

cluster = Cluster_2(mesh=geo)

# ----
# 2. Simulation Domain
number_slider_2 = Slider(50, range=0..1000)

# ----
# 3. Mesh & Simulation
panel_5 = Panel("C:\4_AnnualWindAnalysis")

downloadepw = CSharpScript(epwURL=panel, folder=panel_5, download=Button())  # -> path; inputs epwURL: String, folder: String, download: Boolean
# ---------- downloadepw: C# usings ----------
using System.Net;
using System.IO;
using System.Text;
# ---------- downloadepw: C# ----------
    if(!Directory.Exists(folder)){  Directory.CreateDirectory(folder);}

    if (download == true){

      DownLoadFile(epwURL, folder + "\\weather.epw");



    }

    path = folder + "\\weather.epw";
# ---------- downloadepw: C# additional code ----------
  public static void DownLoadFile(string URL, string FilePath)
  {
    WebClient webClient = new WebClient();
    webClient.DownloadFile(URL, FilePath);
  }
# ---------- end downloadepw ----------

abl = ABL(Uref="2", Zref=10, Z0=1, ZGround=0, Epw=downloadepw)

domaincyl = CylindricalDomain(
    Geometry=geo,
    BoundaryCondition=abl,
    BlockSize="10",
    SizeOfInnerRectangle=number_slider_2,
    SizeOfOuterRadius=Slider(300, range=0..1000),
    Height=Slider(80, range=0..1000))  # -> Domain, Mesh

cellsize = CellSize(SimulationDomain=domaincyl.Domain, BlockSize="10", DesiredCellSize=Slider(3, range=0..10))

mset = MeshSettings(AccBuilding=cellsize, AccFeatures=cellsize, AccRefinement=0, AccGround=cellsize, NLayer=3, Mode=1, Mode_2=1)

rset = RunSettings(
    NumberOfIterations="100",
    WriteInterval=20,
    NumberOfTimestepsToKeep=3,
    TurbulenceModel=1,
    RelaxationFactors=3,
    SolutionAndAlgorithmControl=1,
    PotentialFoamInitialization=False,
    AgeOfAir=True,
    NumberOfCPUs="8",
    OperatingSystem=0)
simulation = Simulation(
    SimulationDomain=domaincyl.Domain,
    WorkingDirectory=panel_5,
    MeshSettings=mset,
    RunSettings=rset,
    RunMeshing=Button(),
    MakeTrees=False,
    RunSimulation=Button(),
    runWithBlueCFD=True)
residuals = Residuals(Result=simulation, SelectionOfWindDirections="0", X=":", Y=":", Version=0, Run=Button(), visResiduals=False)

# ----
# 6. Clean
button_3 = Button()  # disabled
clean = Clean(Directory=panel_5, Mode=2, Run=button_3)  # disabled

paraview = Paraview(Result=simulation, ParaviewVersion=2, Run=button)

# ----
# 4. Probing points & probing
number_slider_3 = Slider(5, range=1..50)
brep = Brep(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)
meshplane = MeshPlane(brep=brep, number=number_slider_3, B=geo)  # -> L, faces, mesh

probing = Probing(BuildingMesh=cluster, Points=meshplane.mesh, ConvertQuadsToTriangles=False)
demesh = DeconstructMesh(Mesh=probing)  # -> Vertices, Faces, Colours, Normals

visprobes = VisualizeProbes(Result=simulation, ProbingPoints=demesh.Vertices, NameOfInstance="ttt", NameOfField=0, Run=Button())  # -> PorbingPoints, ProbingResult

vectors = Data(visprobes.ProbingResult)
points = Data(visprobes.PorbingPoints)
wind_factors = WindFactors(Result=simulation, ProbingPoints=points, WindVelocity=vectors, Run=button_2, Interpolation=False)  # -> WindFactorsSpatial, WindFactorsAnnual
# Multi-directional / annual wind vectors
choose_dir = TreeBranch(Tree=vectors, Path=dir, MaintainPaths=True)
cluster_2 = Cluster(data=choose_dir)  # -> S, E, data_3; disabled
data = Data(wind_factors.WindFactorsSpatial)  # disabled
# Set to -1 for average of entire year (takes 30 s to compute)
data_2 = Data(wind_factors.WindFactorsAnnual)  # disabled

# ----
# Wind Comfort Metrics
vec = Vector(Vector(-271, -230, 0))  # disabled
cluster_3 = Cluster_4(C=points, T=Vector(0, 0, 10))  # disabled
cluster_4 = Cluster_4(C=points, T=Vector(0, 0, 10))  # disabled
pedestrian_wind_comfort = PedestrianWindComfort(WindFactorsSpatial=data, WindFactorsAnnual=data_2, WindComfortMetric=1, Weibull_Fit=False)  # -> WindComfortRank, WindComfortClassLetter, WindComfortClass; disabled
pedestrian_wind_comfort_2 = PedestrianWindComfort(WindFactorsSpatial=data, WindFactorsAnnual=data_2, WindComfortMetric=1, Weibull_Fit=True)  # -> WindComfortRank, WindComfortClassLetter, WindComfortClass; disabled
move = Move(Geometry=cluster_3, Motion=vec)  # -> flatten(Geometry), Transform; disabled
move_2 = Move(Geometry=cluster_4, Motion=Vector(-280.6944615, 0, 0))  # -> flatten(Geometry), Transform; disabled
move_3 = Move(Geometry=geo, Motion=vec)  # -> flatten(Geometry), Transform; disabled
move_4 = Move(Geometry=geo, Motion=Vector(-280.6944615, 0, 0))  # -> flatten(Geometry), Transform; disabled
area = Area(Geometry=move.Geometry)  # -> Area, Centroid; disabled
area_2 = Area(Geometry=move_2.Geometry)  # -> Area, Centroid; disabled
cluster_5 = Cluster(data=pedestrian_wind_comfort.WindComfortRank)  # -> S, E, data_3; disabled
tag = TextTag(Location=area_2.Centroid, Text=pedestrian_wind_comfort.WindComfortClassLetter)  # disabled
cluster_6 = Cluster(data=pedestrian_wind_comfort_2.WindComfortRank)  # -> S, E, data_3; disabled
tag_2 = TextTag(Location=area.Centroid, Text=pedestrian_wind_comfort_2.WindComfortClassLetter)  # disabled
gradient = Gradient(
    LowerLimit=cluster_5.S,
    UpperLimit=cluster_5.E,
    Parameter=cluster_5.data_3,
    stops=[0.103: RGB(0, 0, 255), 0.22: RGB(0, 170, 255), 0.305: RGB(0, 255, 255), 0.398: RGB(0, 255, 188), 0.504: RGB(0, 255, 106), 0.605: RGB(91, 255, 0), 0.699: RGB(184, 255, 0), 0.799: RGB(255, 255, 0), 0.898: RGB(255, 170, 0)])  # disabled
gradient_2 = Gradient(
    LowerLimit=cluster_6.S,
    UpperLimit=cluster_6.E,
    Parameter=cluster_6.data_3,
    stops=[0.103: RGB(0, 0, 255), 0.22: RGB(0, 170, 255), 0.305: RGB(0, 255, 255), 0.398: RGB(0, 255, 188), 0.504: RGB(0, 255, 106), 0.605: RGB(91, 255, 0), 0.699: RGB(184, 255, 0), 0.799: RGB(255, 255, 0), 0.898: RGB(255, 170, 0)])  # disabled
preview = CustomPreview(Geometry=move_2.Geometry, Material=gradient)  # disabled
preview_2 = CustomPreview(Geometry=area.Centroid, Material=gradient_2)  # disabled

gradient_3 = Gradient(
    LowerLimit=cluster_2.S,
    UpperLimit=Slider(6, range=0..10),
    Parameter=cluster_2.data_3,
    stops=[0.103: RGB(0, 0, 255), 0.22: RGB(0, 170, 255), 0.305: RGB(0, 255, 255), 0.398: RGB(0, 255, 188), 0.504: RGB(0, 255, 106), 0.605: RGB(91, 255, 0), 0.699: RGB(184, 255, 0), 0.799: RGB(255, 255, 0), 0.898: RGB(255, 170, 0)])  # disabled
dedata = DeconstructDataObjects(Data=data_2, Select=panel_3)  # disabled
flip = FlipMatrix(Data=dedata)  # disabled
vdisex = VectorDisplayEx(Point=points, Vector=choose_dir, Colour=gradient_3, Width=number_slider)  # disabled
avr = Average(Input=flip)  # -> flatten(ArithmeticMean); disabled
cluster_7 = Cluster(data=avr)  # -> S, E, data_3; disabled
cluster_8 = Cluster_4(C=points, T=Vector(0, 0, 10))  # disabled
gradient_4 = Gradient(
    LowerLimit=cluster_7.S,
    UpperLimit=cluster_7.E,
    Parameter=cluster_7.data_3,
    stops=[0.103: RGB(0, 0, 255), 0.22: RGB(0, 170, 255), 0.305: RGB(0, 255, 255), 0.398: RGB(0, 255, 188), 0.504: RGB(0, 255, 106), 0.605: RGB(91, 255, 0), 0.699: RGB(184, 255, 0), 0.799: RGB(255, 255, 0), 0.898: RGB(255, 170, 0)])  # disabled
preview_3 = CustomPreview(Geometry=cluster_8, Material=gradient_4)  # disabled

# ==== cluster MeshPlane
B = ClusterInput()
number = ClusterInput()
number_2 = Number(number)
settings_custom = SettingsCustom(
    StitchSeams=True,
    SimplePlanes=False,
    Refine=True,
    MinCount=16,
    MaxCount=400,
    AspectRatio=20,
    MaxDistance=0,
    MaxAngle=20,
    MinEdge=number_2,
    MaxEdge=number_2)
brep = ClusterInput()
mesh_brep = MeshBrep(Brep=brep, Settings=settings_custom)
deconstruct_mesh = DeconstructMesh(Mesh=mesh_brep)  # -> Vertices, Faces, Colours, Normals
brepsinc = PointInBreps(Brep=B, Point=deconstruct_mesh.Vertices, Strict=False)  # -> Inside, Index
not = GateNot(A=brepsinc.Inside)
cull = CullPattern(List=deconstruct_mesh.Vertices, CullPattern=not)
faces = ClusterOutput(deconstruct_mesh.Faces)
L = ClusterOutput(cull)
mesh = ClusterOutput(mesh_brep)

# ==== cluster Cluster
data = ClusterInput()
data_2 = Data(data)
data_3 = ClusterOutput(data_2)
bnd = Bounds(Numbers=data_2)
dedomain = DeconstructDomain(Domain=bnd)  # -> Start, End
S = ClusterOutput(dedomain.Start)
E = ClusterOutput(dedomain.End)

# ==== cluster Cluster_2
mesh = ClusterInput()
mesh_2 = Mesh(mesh)
mjoin = MeshJoin(Meshes=mesh_2)
M = ClusterOutput(mjoin)

# ==== cluster Cluster_4
C = ClusterInput()
cluster = Cluster_3(C=C)
T = ClusterInput()
move = Move(Geometry=cluster, Motion=T)  # -> Geometry, Transform
srf = ClusterOutput(cluster)

# ==== cluster Cluster_3
C = ClusterInput()
circle = CircleCNR(Center=C, Normal=Vector(0, 0, 1), Radius=2)
srf = Surface(circle)
srf_2 = ClusterOutput(srf)
